# Grasshopper definition final_grass.gh (Grasshopper 1.0.7)
# plug-ins: GhPolyhedra, LunchBox, Firefly.Core

icosphere = IcoSphere(Plane=PlaneXY(0, 0, 0), Scale=Slider(50, range=0..1000), Density=Slider(3, range=0..4))
face_boundaries = FaceBoundaries(Mesh=icosphere)
boundary_surfaces = BoundarySurfaces(Edges=face_boundaries)
brep_join = BrepJoin(Breps=boundary_surfaces)  # -> Breps, Closed
box = Box(brep_join.Breps)
deconstruct_brep = DeconstructBrep(Brep=box)  # -> Faces, Edges, Vertices
list_item = ListItem(List=reverse(deconstruct_brep.Faces), Index=0, Wrap=True)
list_item_2 = ListItem(List=reverse(deconstruct_brep.Edges), Index=0, Wrap=True)
length = Length(Curve=list_item_2)
division = Division(A=length, B=2)
unit_z = UnitZ(Factor=division)
negative = Negative(Value=unit_z)
move = Move(Geometry=list_item, Motion=negative)  # -> Geometry, Transform
split_brep = SplitBrep(Brep=brep_join.Breps, Cutter=move.Geometry)
list_item_3 = ListItem(List=split_brep, Index=0, Wrap=True)
deconstruct_brep_2 = DeconstructBrep(Brep=list_item_3)  # -> Faces, Edges, Vertices
trigger = Trigger(Interval=200, TimerInterval=200, Target=serial_read_generic)
com_ports_available = COMPortsAvailable()
panel_frame = PanelFrame(Panel=deconstruct_brep_2.Faces, ScaleFactor=Slider(0.7, range=0.1..0.9))  # -> PanelFrame, Panel
serial_read_generic = SerialReadGeneric(StartReadingValues=Toggle(True), PortNumber="5")  # -> SerialOutput, StatusMessage
open_close_port = OpenClosePort(OpenClosePort=Toggle(True), PortNumber="5", BaudRate="9600")
panel = Panel(com_ports_available)
brep = Brep(panel_frame.PanelFrame)
brep_2 = Brep(panel_frame.Panel)
panel_2 = Panel(serial_read_generic.SerialOutput)
panel_3 = Panel(serial_read_generic.StatusMessage)
panel_4 = Panel(open_close_port)
brep_join_2 = BrepJoin(Breps=brep)  # -> Breps, Closed
ghpython_script = GhPythonScript(touch_state=panel_2)  # -> color
# ---------- ghpython_script: Python ----------
__author__ = "song"
__version__ = "2021.12.19"

import rhinoscriptsyntax as rs

if touch_state in "Off!":
    color = (0,0,0);
# ---------- end ghpython_script ----------
ghpython_script_2 = GhPythonScript(touch_state=panel_2)  # -> color
# ---------- ghpython_script_2: Python ----------
__author__ = "song"
__version__ = "2021.12.19"

import rhinoscriptsyntax as rs

if touch_state in "On!":
    color = (223, 125, 128, 255);
# ---------- end ghpython_script_2 ----------
deconstruct_mesh = DeconstructMesh(Mesh=brep_join_2.Breps)  # -> Vertices, Faces, Colours, Normals
construct_mesh = ConstructMesh(Vertices=deconstruct_mesh.Vertices, Faces=deconstruct_mesh.Faces, Colours=ColourSwatch(SwatchColor=RGB(255, 232, 230)))
mesh = Mesh(<mesh referenced from the Rhino model>)
mesh_2 = Mesh(<mesh referenced from the Rhino model>)
mesh_colours = MeshColours(Mesh=mesh_2, Colours=ghpython_script_2)
mesh_colours_2 = MeshColours(Mesh=mesh, Colours=ghpython_script)
